# Grasshopper definition RE_CONC_STRUCT visualization.gh (Grasshopper 1.0.7)
# plug-ins: NGon 2.1, ShapeDiverForGrasshopper, Human, Hops

# ---- group: Hops
# HOPS FOR OUTPUT OF DE_CONC_STRUCT
panel = Panel("D:\OneDrive - Delft University of Technology\CORE\python files\final\csv_set")
hops = Hops(
    Folder_path=panel,
    House_number="1",
    CacheResultsInMemory=True,
    CacheSolveResults=True,
    RemoteDefinitionLocation="http://127.0.0.1:5000/gridGen",
    RemoteSolveVersion=(0, 1, 0),
    ShowInput_Enabled=False,
    ShowInput_Path=False,
    SynchronousSolve=True)  # -> Lenths_x, Lenths_y, Depths_x_path, Depths_y_path, Widths_x_path, Widths_y_path, ColumnsDimensionsX, ColumnsSimensionsY, GridTolerance
panel_2 = Panel(hops.Lenths_y)
panel_3 = Panel(hops.Depths_y_path)
panel_4 = Panel(hops.Lenths_x)
panel_5 = Panel(hops.Widths_x_path)
panel_6 = Panel(hops.ColumnsSimensionsY)
panel_7 = Panel(hops.ColumnsDimensionsX)
panel_8 = Panel(hops.Depths_x_path)
panel_9 = Panel(hops.Widths_y_path)
panel_10 = Panel(hops.GridTolerance)

# ---- group: TRIBUTARY LOADING AREA SELECTOR / path
number_slider = Slider(1, range=0..10)

# ---- group: TRIBUTARY LOADING AREA SELECTOR / index
number_slider_2 = Slider(0, range=0..10)

# ---- group: INPUT BEAM LENGTHS
y = Panel(panel_2)
x = Panel(panel_4)

# ---- group: gap between coumn and beam
panel_11 = Panel("0")

# ---- group: column dim_y
panel_12 = Panel("0.4")

# ---- group: column_dim_z
panel_13 = Panel("3")

# ---- group: column dim_x
panel_14 = Panel("0.4")

# ---- group: csv_widths / beams in x csv
# excel files for widths
# of beams
file_path = FilePath(panel_5)

# ---- group: csv_widths / beams in y csv
file_path_2 = FilePath(panel_9)

# ---- group: beams in y csv
file_path_3 = FilePath(panel_3)

# ---- group: beams in x csv
# excel files for depths
# of beams
file_path_4 = FilePath(panel_8)

# ----
multiplication = Multiplication(A=panel_11, B="2")

# ----
# POINTS ON THE GRID
sddp = ShapeDiverDocumentPayload({AbsoluteTolerance=0, AngleTolerance=0, DistanceDisplayPrecision=0, GltfVersion="Gltf2", InputGroups="{}", OutputGroups="{}", RelativeTolerance=0, UnitSystem=0, VersionCreated="1.13.1.0", VersionSaved="1.13.1.0"})
# GENERATE POINTS OF GRID
y_2 = Panel(y)

# ---- group: width
read_file = ReadFile(File=file_path, PerLineParse=True)
split_list = SplitList(List=simplify(read_file), Index="1")  # -> simplify(ListA), ListB
text_split = TextSplit(Text=split_list.ListB, Separators=", ")  # -> simplify(Result)
panel_15 = Panel(text_split)
panel_16 = Panel(split_list.ListA)

read_file_2 = ReadFile(File=panel_9, PerLineParse=True)
split_list_2 = SplitList(List=simplify(read_file_2), Index="1")  # -> simplify(ListA), ListB
text_split_2 = TextSplit(Text=split_list_2.ListB, Separators=", ")  # -> simplify(Result)
panel_17 = Panel(split_list_2.ListA)
panel_18 = Panel(text_split_2)

# ---- group: adding tolerance to column
addition = Addition(A=panel_12, B=multiplication)
addition_2 = Addition(A=panel_14, B=multiplication)

# ---- group: distances of points from origin for line in x and y
ghpython_script = GhPythonScript(x=x)  # -> out, y; inputs x: list of Int32
# ---------- ghpython_script: Python ----------
__author__ = "tahir"
__version__ = "2023.10.15"

import rhinoscriptsyntax as rs

y=[]
sum = 0
for i in x:
    sum+= i
    y.append(sum)
# ---------- end ghpython_script ----------
panel_19 = Panel(ghpython_script.y)
unit_x = UnitX(Factor=panel_19)

ghpython_script_2 = GhPythonScript(x=y)  # -> out, y; inputs x: list of Int32; same code as ghpython_script
panel_20 = Panel(ghpython_script_2.y)
unit_y = UnitY(Factor=panel_20)

# ---- group: half the column width+tolerance
division = Division(A=addition, B="1")
division_2 = Division(A=addition_2, B="1")

# ---- group: origin
construct_point = ConstructPoint(XCoordinate=0, YCoordinate=0, ZCoordinate=0)

# ----
move = Move(Geometry=construct_point, Motion=unit_x)  # -> Geometry, Transform

# ---- group: points in 1st row
merge = Merge(Data1=construct_point, Data2=move.Geometry)

# ---- group: points in other rows
move_2 = Move(Geometry=merge, Motion=graft(unit_y))  # -> simplify(Geometry), Transform

# ---- group: shifting by one branch so branch is availbale for first row
panel_21 = Panel(move_2.Geometry)
path_mapper = PathMapper(panel_21, source="{A}(i)", target="{A+1}(i)")
panel_22 = Panel(path_mapper)

# ---- group: first row
panel_23 = Panel(merge)

# ----
list_length = ListLength(List=x)
addition_3 = Addition(A=list_length, B="1")

# ---- group: first row merged with rest
merge_2 = Merge(Data1=panel_22, Data2=panel_23)

# ---- group: half the column width+tolerance
panel_24 = Panel(division_2)

# ---- group: points from coord and retain tree structure
ghpython_script_3 = GhPythonScript(x=merge_2)  # -> out, a
# ---------- ghpython_script_3: Python ----------
__author__ = "tahir"
__version__ = "2023.10.15"

import rhinoscriptsyntax as rs
print(x)
# ---------- end ghpython_script_3 ----------
point = Point(ghpython_script_3.out)
trim_tree = TrimTree(Tree=point, Depth=1)

# ----
list_length_2 = ListLength(List=y_2)
addition_4 = Addition(A=list_length_2, B="1")

# ---- group: half the column width+tolerance
panel_25 = Panel(division)

# ----
x_2 = Panel(x)

# ---- group: points from coord and retain tree structure / original
panel_26 = Panel(trim_tree)

# ---- group: moving the points in y
ghpython_script_4 = GhPythonScript(x=panel_25, n=list_length_2)  # -> simplify(y); inputs n: Int32
# ---------- ghpython_script_4: Python ----------
__author__ = "tahir"
__version__ = "2023.10.15"

import rhinoscriptsyntax as rs

y=[]
sum = 0
for i in range(0,n+1):
    y.append(sum)
    sum+= x
print(y)
# ---------- end ghpython_script_4 ----------
panel_27 = Panel(ghpython_script_4)
unit_y_2 = UnitY(Factor=graft(panel_27))
move_3 = Move(Geometry=trim_tree, Motion=unit_y_2)  # -> simplify(Geometry), Transform

ghpython_script_5 = GhPythonScript(x=panel_24, n=list_length)  # -> simplify(y); inputs n: Int32; same code as ghpython_script_4
path_mapper_2 = PathMapper(ghpython_script_5, source="{A;B}", target="{A}")
panel_28 = Panel(path_mapper_2)
unit_x_2 = UnitX(Factor=panel_28)
move_4 = Move(Geometry=move_3.Geometry, Motion=unit_x_2)  # -> simplify(Geometry), Transform

# ---- group: does beam length match
list_item = ListItem(List=move_3.Geometry, Index=0, Wrap=True)
list_item_2 = ListItem(List=flatten(list_item), Index=0, Wrap=True)  # -> Item, Item1, Item2, Item3, Item4, Item5
point_2 = Point(list_item_2.Item)
point_3 = Point(list_item_2.Item1)
distance = Distance(PointA=point_2, PointB=point_3)
panel_29 = Panel(distance)

tree_branch = TreeBranch(Tree=move_4.Geometry, Path="0", MaintainPaths=True)
list_item_3 = ListItem(List=flatten(tree_branch), Index=0, Wrap=True)  # -> Item, Item1, Item2, Item3, Item4, Item5
point_4 = Point(list_item_3.Item)
point_5 = Point(list_item_3.Item1)
distance_2 = Distance(PointA=point_4, PointB=point_5)
panel_30 = Panel(distance_2)

# ---- group: points / adjusted grid with column dimensions
point_6 = Point(move_4.Geometry)

# ---- group: making rectangles from 2 points
tree_branch_2 = TreeBranch(Tree=point_6, Path="1", MaintainPaths=True)

tree_branch_3 = TreeBranch(Tree=point_6, Path="0", MaintainPaths=True)

tree_branch_4 = TreeBranch(Tree=point_6, Path="2", MaintainPaths=True)

tree_branch_5 = TreeBranch(Tree=point_6, Path="3", MaintainPaths=True)

tree_branch_6 = TreeBranch(Tree=point_6, Path="5", MaintainPaths=True)

tree_branch_7 = TreeBranch(Tree=point_6, Path="4", MaintainPaths=True)

tree_branch_8 = TreeBranch(Tree=point_6, Path="6", MaintainPaths=True)

tree_branch_9 = TreeBranch(Tree=point_6, Path="7", MaintainPaths=True)

shift_list = ShiftList(List=tree_branch_2, Shift=1, Wrap=True)
shift_list_2 = ShiftList(List=tree_branch_5, Shift=1, Wrap=True)
shift_list_3 = ShiftList(List=tree_branch_6, Shift=1, Wrap=True)
shift_list_4 = ShiftList(List=tree_branch_9, Shift=1, Wrap=True)
rectangle_2pt = Rectangle2Pt(Plane=PlaneXY(0, 0, 0), PointA=tree_branch_3, PointB=shift_list, Radius=0)  # -> Rectangle, Length
rectangle_2pt_2 = Rectangle2Pt(Plane=PlaneXY(0, 0, 0), PointA=shift_list, PointB=tree_branch_4, Radius=0)  # -> Rectangle, Length
rectangle_2pt_3 = Rectangle2Pt(Plane=PlaneXY(0, 0, 0), PointA=tree_branch_4, PointB=shift_list_2, Radius=0)  # -> Rectangle, Length
rectangle_2pt_4 = Rectangle2Pt(Plane=PlaneXY(0, 0, 0), PointA=tree_branch_8, PointB=shift_list_4, Radius=0)  # -> Rectangle, Length
rectangle_2pt_5 = Rectangle2Pt(Plane=PlaneXY(0, 0, 0), PointA=shift_list_2, PointB=tree_branch_7, Radius=0)  # -> Rectangle, Length
rectangle_2pt_6 = Rectangle2Pt(Plane=PlaneXY(0, 0, 0), PointA=shift_list_3, PointB=tree_branch_8, Radius=0)  # -> Rectangle, Length
rectangle_2pt_7 = Rectangle2Pt(Plane=PlaneXY(0, 0, 0), PointA=tree_branch_7, PointB=shift_list_3, Radius=0)  # -> Rectangle, Length

# ----
# GRID 2D
entwine = Entwine(
    Branch00=rectangle_2pt.Rectangle,
    Branch01=rectangle_2pt_2.Rectangle,
    Branch02=rectangle_2pt_3.Rectangle,
    Branch03=rectangle_2pt_5.Rectangle,
    Branch04=rectangle_2pt_7.Rectangle,
    Branch05=rectangle_2pt_6.Rectangle,
    Branch06=rectangle_2pt_4.Rectangle,
    FlattenInputs=True)

# ---- group: filtering out the rectangles to be used
list_length_3 = ListLength(List=merge)
subtraction = Subtraction(A=list_length_3, B="1")

# ---- group: shifted index and branch
path_mapper_3 = PathMapper(point_6, source="{A}(i)", target="{A+1}(i+1)")
panel_31 = Panel(path_mapper_3)

# ---- group: filtering out the rectangles to be used
split_list_3 = SplitList(List=entwine, Index=subtraction)  # -> ListA, ListB

# ---- group: shifted index and branch / points from coord and retain tree structure
ghpython_script_6 = GhPythonScript(x=panel_31)  # -> out, a; same code as ghpython_script_3
point_7 = Point(ghpython_script_6.out)
trim_tree_2 = TrimTree(Tree=point_7, Depth=1)

# ---- group: filtering out the rectangles to be used / lines / GRID CURVES
clean_tree = CleanTree(RemoveNulls=True, RemoveInvalid=True, RemoveEmpty=True, Tree=split_list_3.ListA)  # -> simplify(Tree)

# ---- group: filtering out the rectangles to be used / lines
custom_preview_lineweights = CustomPreviewLineweights(Geometry=clean_tree, Shader=ColourSwatch(SwatchColor=RGB(0, 0, 0)), Absolute=False)

# ----
# TEST
number_slider_3 = Slider(3, range=0..10)
number_slider_4 = Slider(5, range=0..10)

tree_item = TreeItem(Tree=trim_tree_2, Path=number_slider_3, Index=number_slider_4, Wrap=True)
tree_item_2 = TreeItem(Tree=point_6, Path=number_slider_3, Index=number_slider_4, Wrap=True)
xy_plane = XYPlane(Origin=Point(0, 0, 0))
rectangle_2pt_8 = Rectangle2Pt(Plane=xy_plane, PointA=tree_item, PointB=tree_item_2, Radius=0)  # -> Rectangle, Length
list_item_4 = ListItem(List=rectangle_2pt_8.Rectangle, Index=0, Wrap=True)  # -> Item, Item1, Item2
curve = Curve(list_item_4.Item2)

# ---- group: tributary loading area / selecting the row and the item in that row
curve_2 = Curve(simplify(split_list_3.ListA))
panel_32 = Panel(number_slider)
tree_branch_10 = TreeBranch(Tree=curve_2, Path=panel_32, MaintainPaths=True)
list_item_5 = ListItem(List=tree_branch_10, Index=number_slider_2, Wrap=True)  # -> Item, Item1, Item2, Item3, Item4
curve_3 = Curve(list_item_5.Item)

# ---- group: GRID CURVES
curve_4 = Curve(clean_tree)

# ----
panel_33 = Panel("""0.5
0.25
0.1
0.25""")
dash_pattern = DashPattern(Curve=curve_4, Pattern=panel_33)  # -> Dashes, Gaps
custom_preview_lineweights_2 = CustomPreviewLineweights(Geometry=dash_pattern.Dashes, Shader=ColourSwatch(SwatchColor=RGB(0, 0, 0)), Thickness="1", Absolute=False)

y_3 = Panel(y)

x_3 = Panel(x)

# ---- group: tributary loading area / decosntructing rectangle
area = Area(Geometry=curve_3)  # -> Area, Centroid
discontinuity = Discontinuity(Curve=curve_3, Level=1)  # -> Points, Parameters
list_item_6 = ListItem(List=discontinuity.Points, Index=0, Wrap=True)  # -> Item, Item1, Item2, Item3

# ---- group: tributary loading area
panel_34 = Panel("""1
-1
-1
1""")
unit_x_3 = UnitX(Factor=expr("10*x", panel_34))
panel_35 = Panel("""1
1
-1
-1""")
unit_y_3 = UnitY(Factor=expr("10*x", panel_35))
move_5 = Move(Geometry=discontinuity.Points, Motion=unit_x_3)  # -> Geometry, Transform
move_6 = Move(Geometry=move_5.Geometry, Motion=unit_y_3)  # -> Geometry, Transform

# ---- group: beams and columns 2d / beam width_x / width
read_file_3 = ReadFile(File=file_path, PerLineParse=True)
split_list_4 = SplitList(List=simplify(read_file_3), Index="1")  # -> simplify(ListA), ListB
text_split_3 = TextSplit(Text=split_list_4.ListB, Separators=", ")  # -> simplify(Result)
panel_36 = Panel(text_split_3)
panel_37 = Panel(split_list_4.ListA)

# ---- group: beams and columns 2d / column / column dim_x
panel_38 = Panel(panel_14)

# ---- group: beams and columns 2d / column / column dim_y
panel_39 = Panel(panel_12)

# ---- group: beams and columns 2d / beam width_y
read_file_4 = ReadFile(File=file_path_2, PerLineParse=True)
split_list_5 = SplitList(List=simplify(read_file_4), Index="1")  # -> simplify(ListA), ListB
text_split_4 = TextSplit(Text=split_list_5.ListB, Separators=", ")  # -> simplify(Result)
panel_40 = Panel(text_split_4)
panel_41 = Panel(split_list_5.ListA)
path_mapper_4 = PathMapper(panel_40, source="{A}(i)", target="{i}(A)")
panel_42 = Panel(path_mapper_4)

# ---- group: beams and columns 2d / column
rectangle = Rectangle(Plane=point_6, XSize=panel_38, YSize=panel_39, Radius=0)  # -> Rectangle, Length

# ---- group: beams and columns 2d / column / reorienting the column to the centre
division_3 = Division(A=[panel_38, panel_39], B="2")
list_item_7 = ListItem(List=division_3, Index=0, Wrap=True)  # -> Item, Item1
unit_y_4 = UnitY(Factor=expr("-x", list_item_7.Item1))
unit_x_4 = UnitX(Factor=expr("-x", list_item_7.Item))
move_7 = Move(Geometry=rectangle.Rectangle, Motion=unit_x_4)  # -> Geometry, Transform
move_8 = Move(Geometry=move_7.Geometry, Motion=unit_y_4)  # -> Geometry, Transform

# ---- group: beams and columns 2d / beam width_x / branch
list_length_4 = ListLength(List=y_3)
subtraction_2 = Subtraction(A=list_length_4, B="1")
panel_43 = Panel(curve_4)
tree_branch_11 = TreeBranch(Tree=curve_4, Path=subtraction_2, MaintainPaths=True)

# ---- group: tributary loading area
line = Line(StartPoint=discontinuity.Points, EndPoint=move_6.Geometry)
list_item_8 = ListItem(List=line, Index=0, Wrap=True)  # -> Item, Item1, Item2, Item3
curve_proximity = CurveProximity(CurveA=list_item_8.Item, CurveB=list_item_8.Item1)  # -> PointA, PointB, Distance
curve_proximity_2 = CurveProximity(CurveA=list_item_8.Item2, CurveB=list_item_8.Item3)  # -> PointA, PointB, Distance

unit_y_5 = UnitY(Factor=1)
move_9 = Move(Geometry=area.Centroid, Motion=unit_y_5)  # -> Geometry, Transform
line_2 = Line(StartPoint=move_9.Geometry, EndPoint=area.Centroid)

unit_x_5 = UnitX(Factor=1)
move_10 = Move(Geometry=area.Centroid, Motion=unit_x_5)  # -> Geometry, Transform
line_3 = Line(StartPoint=area.Centroid, EndPoint=move_10.Geometry)

# ---- group: beams and columns 2d / beam width_x
tree_branch_12 = TreeBranch(Tree=panel_36, Path="0", MaintainPaths=True)

# ---- group: beams and columns 2d / beam width_y / adding the nulling the branch
path_mapper_5 = PathMapper(curve_4, source="{A}(i)", target="{A}(i+1)")
panel_44 = Panel(path_mapper_5)

# ---- group: beams and columns 2d / beam width_x / mirroring the last box for x
bounding_box = BoundingBox(Content=tree_branch_11, Plane=PlaneXY(0, 0, 0), UnionBox=True)  # -> Box, Box_2
deconstruct_brep = DeconstructBrep(Brep=bounding_box.Box)  # -> Faces, Edges, Vertices
curve_middle = CurveMiddle(Curve=deconstruct_brep.Edges)
list_item_9 = ListItem(List=curve_middle, Index=0, Wrap=True)  # -> Item, Item1, Item2, Item3
point_8 = Point(list_item_9.Item3)
point_9 = Point(list_item_9.Item1)
unit_z = UnitZ(Factor=1)
line_4 = Line(StartPoint=point_9, EndPoint=point_8)
extrude = Extrude(Base=line_4, Direction=unit_z)
mirror = Mirror(Geometry=tree_branch_11, Plane=extrude)  # -> simplify(Geometry), Transform

# ---- group: beams and columns 2d / beam width_x / reducing scale of sample
division_4 = Division(A=panel_36, B="5")

# ---- group: tributary loading area / points
point_10 = Point(list_item_6.Item)
point_11 = Point(curve_proximity_2.PointA)
point_12 = Point(curve_proximity.PointA)
point_13 = Point(list_item_6.Item2)
point_14 = Point(list_item_6.Item3)
point_15 = Point(list_item_6.Item1)

# ---- group: beams and columns 2d / column / 2D
surface = Surface(move_8.Geometry)
# BEAMS AND COLUMNS (2D)
custom_preview = CustomPreview(Geometry=surface, Material=ColourSwatch(SwatchColor=RGB(181, 114, 164)))

# ---- group: beams and columns 2d / beam width_y / reducing scale of sample
division_5 = Division(A=panel_42, B="5")

# ---- group: tributary loading area
line_5 = Line(StartPoint=point_12, EndPoint=point_11)
line_6 = Line(StartPoint=point_12, EndPoint=point_10)
line_7 = Line(StartPoint=point_10, EndPoint=point_14)
line_8 = Line(StartPoint=point_14, EndPoint=point_11)
line_9 = Line(StartPoint=point_11, EndPoint=point_13)
line_10 = Line(StartPoint=point_13, EndPoint=point_14)
line_11 = Line(StartPoint=point_14, EndPoint=point_11)

# TRIBUTARY LOADING AREAS
line_12 = Line(list_item_8.Item1)
line_13 = Line(list_item_8.Item2)
curve_proximity_3 = CurveProximity(CurveA=line_12, CurveB=line_13)  # -> PointA, PointB, Distance
curve_proximity_4 = CurveProximity(CurveA=line_6, CurveB=line_8)  # -> PointA, PointB, Distance

line_14 = Line(StartPoint=curve_proximity_4.PointA, EndPoint=point_10)
line_15 = Line(StartPoint=curve_proximity_3.PointA, EndPoint=curve_proximity_4.PointA)
line_16 = Line(StartPoint=point_14, EndPoint=point_10)
line_17 = Line(StartPoint=curve_proximity_4.PointA, EndPoint=point_14)
line_18 = Line(StartPoint=point_14, EndPoint=point_13)
line_19 = Line(StartPoint=curve_proximity_3.PointA, EndPoint=point_13)

# ---- group: beams and columns 2d / beam width_x / changing the branch identity
path_mapper_6 = PathMapper(mirror.Geometry, source="{A;B}", target="{A+1}")
panel_45 = Panel(path_mapper_6)

# ---- group: beams and columns 2d / beam width_x / merging the mirrored last one and the rest
merge_3 = Merge(Data1=curve_4, Data2=path_mapper_6)
panel_46 = Panel(merge_3)

# ---- group: beams and columns 2d / beam width_x / exploding into segments
curve_5 = Curve(merge_3)
explode = Explode(Curve=curve_5, Recursive=True)  # -> Segments, Vertices
list_item_10 = ListItem(List=explode.Segments, Index=0, Wrap=True)  # -> Item, Item1

# ---- group: beams and columns 2d / beam width_x / x_lines
curve_6 = Curve(list_item_10.Item)

# ---- group: tributary loading area / tributary area options / tributary area if x > y
join_curves = JoinCurves(Curves=[line_17, line_14, line_16], Preserve=False)
join_curves_2 = JoinCurves(Curves=[line_19, line_18, line_17, line_15], Preserve=False)
mirror_curve = MirrorCurve(Geometry=join_curves_2, Curve=line_3, Tangent=True)
mirror_curve_2 = MirrorCurve(Geometry=join_curves, Curve=line_5, Tangent=True)
merge_4 = Merge(Data1=mirror_curve_2, Data2=mirror_curve, Data3=join_curves, Data4=join_curves_2)

# ---- group: tributary loading area / tributary area options / tributary area if x < y
join_curves_3 = JoinCurves(Curves=[line_9, line_10, line_11], Preserve=False)
join_curves_4 = JoinCurves(Curves=[line_5, line_6, line_7, line_8], Preserve=False)
mirror_curve_3 = MirrorCurve(Geometry=join_curves_3, Curve=line_3, Tangent=True)
mirror_curve_4 = MirrorCurve(Geometry=join_curves_4, Curve=line_5, Tangent=True)

# ---- group: tributary loading area / tributary area options / tributary area if x = y
mirror_curve_5 = MirrorCurve(Geometry=join_curves_4, Curve=line_2, Tangent=True)
merge_5 = Merge(Data1=mirror_curve_5, Data2=mirror_curve_3, Data3=join_curves_4, Data4=join_curves_3)

# ---- group: beams and columns 2d / beam width_x / cascading points for rectangle / half the column width+tolerance
panel_47 = Panel(division_2)

# ---- group: beams and columns 2d / beam width_x / for rectangle
division_6 = Division(A=panel_36, B="2")
unit_y_6 = UnitY(Factor=expr("-x", division_6))  # -> simplify(graft(UnitVector))
unit_y_7 = UnitY(Factor=division_6)  # -> simplify(graft(UnitVector))

# ---- group: beams and columns 2d / beam width_y / for column / half the column width+tolerance
panel_48 = Panel(division)

# ---- group: tributary loading area / tributary area options
merge_6 = Merge(Data1=mirror_curve_4, Data2=mirror_curve_3, Data3=join_curves_4, Data4=join_curves_3)

# ---- group: tributary loading area / if statements / if statement returns 1 if x>y dimension
explode_2 = Explode(Curve=curve_3, Recursive=True)  # -> Segments, Vertices
list_item_11 = ListItem(List=explode_2.Segments, Index=0, Wrap=True)  # -> Item, Item1, Item2, Item3
curve_7 = Curve(list_item_11.Item1)
curve_8 = Curve(list_item_11.Item)
length = Length(Curve=curve_8)
length_2 = Length(Curve=curve_7)
expression = Expression(x=length, y=length_2, Expression="if(x>y,1,0)")

# ---- group: tributary loading area / text display / selecting the points for displaying x dimensions
tree_branch_13 = TreeBranch(Tree=curve_2, Path="0", MaintainPaths=True)
list_item_12 = ListItem(List=tree_branch_13, Index=0, Wrap=True)  # -> Item, Item1, Item2, Item3, Item4
rectangle_2 = Rectangle(tree_branch_13)
explode_3 = Explode(Curve=rectangle_2, Recursive=True)  # -> Segments, Vertices
list_item_13 = ListItem(List=explode_3.Segments, Index=0, Wrap=True)
unit_y_8 = UnitY(Factor=expr("-x", 1))
curve_middle_2 = CurveMiddle(Curve=list_item_13)
move_11 = Move(Geometry=curve_middle_2, Motion=unit_y_8)  # -> flatten(Geometry), Transform

# ---- group: tributary loading area / text display / selecting the points for displaying y dimensions
list_item_14 = ListItem(List=entwine, Index=0, Wrap=True)
explode_4 = Explode(Curve=list_item_14, Recursive=True)  # -> Segments, Vertices
list_item_15 = ListItem(List=explode_4.Segments, Index=0, Wrap=True)  # -> Item, Item1, Item2, Item3
unit_x_6 = UnitX(Factor=expr("-x", 1))
curve_middle_3 = CurveMiddle(Curve=list_item_15.Item3)
move_12 = Move(Geometry=flatten(curve_middle_3), Motion=unit_x_6)  # -> Geometry, Transform

# ---- group: tributary loading area / if statements
panel_49 = Panel(expression)
stream_filter = StreamFilter(Gate=panel_49, Stream0=merge_6, Stream1=merge_4)

# ---- group: tributary loading area / if statements / if statement returns 1 if x=y dimension
expression_2 = Expression(x=length, y=length_2, Expression="if(x=y,1,0)")
panel_50 = Panel(expression_2)
stream_filter_2 = StreamFilter(Gate=panel_50, Stream0=stream_filter, Stream1=merge_5)

# ---- group: tributary loading area / display area
list_item_16 = ListItem(List=stream_filter_2, Index=0, Wrap=True)  # -> Item, Item1, Item2, Item3
surface_2 = Surface(stream_filter_2)

# ---- group: tributary loading area / text display
boolean_toggle = BooleanToggle(True)
number_slider_5 = Slider(1, range=0..1)
text = Text(
    Location=move_11.Geometry,
    Text=x_3,
    Size=number_slider_5,
    Bold=boolean_toggle,
    HorizontalAlignment=0,
    VerticalAlignment=0)
text_2 = Text(
    Location=move_12.Geometry,
    Text=y_2,
    Size=number_slider_5,
    Bold=boolean_toggle,
    HorizontalAlignment=0,
    VerticalAlignment=0)

# ---- group: tributary loading area / display area
area_2 = Area(Geometry=[list_item_16.Item, list_item_16.Item1, list_item_16.Item2, list_item_16.Item3])  # -> Area, Centroid
panel_51 = Panel(area_2.Area)
text_3 = Text(
    Location=area_2.Centroid,
    Text=panel_51,
    Size=Slider(0.2, range=0..2),
    Bold=Toggle(True),
    HorizontalAlignment=0,
    VerticalAlignment=0)

# ---- group: GEOMETRY / beam depth_x
read_file_5 = ReadFile(File=file_path_4, PerLineParse=True)
split_list_6 = SplitList(List=simplify(read_file_5), Index="1")  # -> simplify(ListA), ListB
text_split_5 = TextSplit(Text=split_list_6.ListB, Separators=", ")  # -> simplify(Result)
panel_52 = Panel(split_list_6.ListA)
panel_53 = Panel(text_split_5)
path_mapper_7 = PathMapper(panel_53, source="{A}(i)", target="{i}(A)")
panel_54 = Panel(path_mapper_7)

# ---- group: GEOMETRY / beam depth_y
read_file_6 = ReadFile(File=file_path_3, PerLineParse=True)
split_list_7 = SplitList(List=simplify(read_file_6), Index="1")  # -> simplify(ListA), ListB
text_split_6 = TextSplit(Text=split_list_7.ListB, Separators=", ")  # -> simplify(Result)
panel_55 = Panel(text_split_6)
panel_56 = Panel(split_list_7.ListA)
path_mapper_8 = PathMapper(panel_55, source="{A}(i)", target="{i}(A)")
panel_57 = Panel(path_mapper_8)

# ---- group: tributary loading area / text display
custom_preview_lineweights_3 = CustomPreviewLineweights(Geometry=[text_2, text], Shader=ColourSwatch(SwatchColor=RGB(255, 255, 255)), Thickness="2", Absolute=False)

# ---- group: tributary loading area / display area
custom_preview_2 = CustomPreview(Geometry=text_3, Material=ColourSwatch(SwatchColor=RGB(255, 255, 255)))

# ---- group: GEOMETRY / column height
panel_58 = Panel(panel_13)

# ---- group: GEOMETRY / column extrusion
unit_z_2 = UnitZ(Factor=panel_58)
extrude_2 = Extrude(Base=surface, Direction=unit_z_2)
cap_holes = CapHoles(Brep=extrude_2)

# ---- group: GEOMETRY / column extrusion / lines
deconstruct_brep_2 = DeconstructBrep(Brep=cap_holes)  # -> Faces, Edges, Vertices
# BEAMS AND COLUMNS (3D)
custom_preview_lineweights_4 = CustomPreviewLineweights(Geometry=deconstruct_brep_2.Edges, Shader=ColourSwatch(SwatchColor=RGB(0, 0, 0)), Absolute=False)

# ---- group: GEOMETRY / column extrusion
custom_preview_3 = CustomPreview(Geometry=cap_holes, Material=ColourSwatch(SwatchColor=RGB(191, 191, 191)))

# ---- group: generating tree
panel_59 = Panel("""A1
A2
A3
A4
A5""")
panel_60 = Panel("""C1
C2
C3
C4
C5""")
panel_61 = Panel("""B1
B2
B3
B4
B5""")
entwine_2 = Entwine(Branch00=panel_59, Branch01=panel_61, Branch02=panel_60, FlattenInputs=True)  # -> simplify(Result)
panel_62 = Panel(entwine_2)

# ---- group: CONNECTORS
panel_63 = Panel(cap_holes)
path_mapper_9 = PathMapper(cap_holes, source="{A}(i)", target="{A+1}(i)")
panel_64 = Panel(path_mapper_9)
path_mapper_10 = PathMapper(cap_holes, source="{A}(i)", target="{A;1}(i)")
path_mapper_11 = PathMapper(path_mapper_9, source="{A}(i)", target="{A;0}(i)")
panel_65 = Panel(path_mapper_11)
panel_66 = Panel(path_mapper_10)
merge_7 = Merge(Data1=path_mapper_10, Data2=path_mapper_11)
panel_67 = Panel(merge_7)

# ----
path_mapper_12 = PathMapper(panel_62, source="{A}(i)", target="{A+1}(i)")
panel_68 = Panel(path_mapper_12)
path_mapper_13 = PathMapper(panel_62, source="{A}(i)", target="{A;1}(i)")
path_mapper_14 = PathMapper(panel_68, source="{A}(i)", target="{A;0}(i)")
# TEST FOR PATH MAPPING
panel_69 = Panel(path_mapper_13)
panel_70 = Panel(path_mapper_14)
merge_8 = Merge(Data1=panel_69, Data2=panel_70)
panel_71 = Panel(merge_8)

# ---- group: CONNECTORS / bra / removing 1st and last tree branch
list_length_5 = ListLength(List=y_3)
addition_5 = Addition(A=list_length_5, B="1")

# ---- group: removing 1st and last tree branch / removing first of A tree and last of B tree
concatenate = Concatenate(Fragment_A="{", Fragment_B="3", A=";*}[*]")  # -> simplify(Result)
panel_72 = Panel(concatenate)

# ---- group: CONNECTORS / bra / removing 1st and last tree branch / removing first of A tree and last of B tree
panel_73 = Panel(addition_5)
concatenate_2 = Concatenate(Fragment_A="{", Fragment_B=panel_73, A=";*}[*]")  # -> simplify(Result)
panel_74 = Panel(concatenate_2)

# ---- group: removing 1st and last tree branch / removing first of A tree and last of B tree
panel_75 = Panel("{0;*}[*]")

# ---- group: CONNECTORS / bra / removing 1st and last tree branch / removing first of A tree and last of B tree
panel_76 = Panel("{0;*}[*]")

# ---- group: removing 1st and last tree branch
merge_9 = Merge(Data1=panel_75, Data2=panel_72)
split_tree = SplitTree(Data=panel_71, Masks=flatten(merge_9))  # -> Positive, Negative
panel_77 = Panel(split_tree.Negative)
clean_tree_2 = CleanTree(RemoveNulls=True, RemoveInvalid=True, RemoveEmpty=True, Tree=split_tree.Negative)
panel_78 = Panel(clean_tree_2)

# ---- group: CONNECTORS / bra / removing 1st and last tree branch
merge_10 = Merge(Data1=panel_76, Data2=panel_74)
split_tree_2 = SplitTree(Data=merge_7, Masks=flatten(merge_10))  # -> Positive, Negative
panel_79 = Panel(split_tree_2.Negative)
clean_tree_3 = CleanTree(RemoveNulls=True, RemoveInvalid=True, RemoveEmpty=True, Tree=split_tree_2.Negative)
panel_80 = Panel(clean_tree_3)

# ---- group: remapping
path_mapper_15 = PathMapper(panel_78, source="{A;B}[i]", target="{A-1;B}[i]")
panel_81 = Panel(path_mapper_15)

# ---- group: CONNECTORS / bra / remapping
path_mapper_16 = PathMapper(clean_tree_3, source="{A;B}[i]", target="{A-1;B}[i]")
panel_82 = Panel(path_mapper_16)

# ---- group: CONNECTORS / splitting two column branches
split_tree_3 = SplitTree(Data=path_mapper_16, Masks=flatten("{*;0}[*]"))  # -> Positive, Negative
panel_84 = Panel(split_tree_3.Positive)
panel_85 = Panel(split_tree_3.Negative)
clean_tree_4 = CleanTree(RemoveNulls=True, RemoveInvalid=True, RemoveEmpty=True, Tree=split_tree_3.Positive)  # -> simplify(Tree)
clean_tree_5 = CleanTree(RemoveNulls=True, RemoveInvalid=True, RemoveEmpty=True, Tree=split_tree_3.Negative)  # -> simplify(Tree)
panel_86 = Panel(clean_tree_5)
panel_87 = Panel(clean_tree_4)

# ---- group: beams and columns 2d / beam width_y / branch
list_length_6 = ListLength(List=x_2)
subtraction_3 = Subtraction(A=list_length_6, B="1")

# ---- group: beams and columns 2d / beam width_y
panel_89 = Panel("0")

# ---- group: beams and columns 2d / beam width_y / branch (continued)
list_item_17 = ListItem(List=curve_4, Index=panel_89, Wrap=True)

# ---- group: beams and columns 2d / beam width_y / mirroring the last box for x
bounding_box_2 = BoundingBox(Content=list_item_17, Plane=PlaneXY(0, 0, 0), UnionBox=True)  # -> Box, Box_2
deconstruct_brep_3 = DeconstructBrep(Brep=bounding_box_2.Box)  # -> Faces, Edges, Vertices
curve_middle_4 = CurveMiddle(Curve=deconstruct_brep_3.Edges)
list_item_18 = ListItem(List=curve_middle_4, Index=0, Wrap=True)  # -> Item, Item1, Item2, Item3
point_16 = Point(list_item_18.Item)
point_17 = Point(list_item_18.Item2)
unit_z_3 = UnitZ(Factor=1)
line_20 = Line(StartPoint=point_16, EndPoint=point_17)
extrude_3 = Extrude(Base=line_20, Direction=unit_z_3)
mirror_2 = Mirror(Geometry=list_item_17, Plane=extrude_3)  # -> simplify(Geometry), Transform

# ---- group: beams and columns 2d / beam width_y / replace nulls
replace_nulls = ReplaceNulls(Items=path_mapper_5, Replacements=mirror_2.Geometry)  # -> Items, Count
panel_90 = Panel(replace_nulls.Items)

# ---- group: beams and columns 2d / beam width_y / exploding into segments
curve_9 = Curve(replace_nulls.Items)
explode_5 = Explode(Curve=curve_9, Recursive=True)  # -> Segments, Vertices
list_item_19 = ListItem(List=explode_5.Segments, Index=0, Wrap=True)  # -> Item, Item1

# ---- group: beams and columns 2d / beam width_y / y_lines
curve_10 = Curve(simplify(list_item_19.Item1))

# ---- group: beams and columns 2d / beam width_x / cascading points for rectangle
end_points = EndPoints(Curve=simplify(curve_6))  # -> Start, End

# ---- group: beams and columns 2d / beam width_x / cascading points for rectangle / for column
unit_x_7 = UnitX(Factor=expr("-x", panel_47))  # -> simplify(graft(UnitVector))
unit_x_8 = UnitX(Factor=panel_47)  # -> simplify(graft(UnitVector))
move_13 = Move(Geometry=[end_points.Start, end_points.End], Motion=[unit_x_8, unit_x_7])  # -> Geometry, Transform

# ---- group: beams and columns 2d / beam width_x / cascading points for rectangle (continued)
move_14 = Move(Geometry=move_13.Geometry, Motion=[unit_y_7, unit_y_6])  # -> Geometry, Transform
panel_91 = Panel(move_14.Geometry)
list_item_20 = ListItem(List=move_14.Geometry, Index=0, Wrap=True)  # -> Item, Item1

# ---- group: beams and columns 2d / beam width_x / rectangles
rectangle_2pt_9 = Rectangle2Pt(Plane=PlaneXY(0, 0, 0), PointA=list_item_20.Item, PointB=list_item_20.Item1, Radius=0)  # -> Rectangle, Length
surface_3 = Surface(rectangle_2pt_9.Rectangle)

# ---- group: beams and columns 2d / beam width_x / dimensions
explode_6 = Explode(Curve=rectangle_2pt_9.Rectangle, Recursive=True)  # -> Segments, Vertices
list_item_21 = ListItem(List=explode_6.Segments, Index=0, Wrap=True)
length_3 = Length(Curve=list_item_21)
panel_92 = Panel(length_3)

# ---- group: beams and columns 2d / beam width_x / 2D
colour_swatch = ColourSwatch(SwatchColor=RGBA(234, 255, 0, 180))
custom_preview_4 = CustomPreview(Geometry=surface_3, Material=colour_swatch)

# ---- group: GEOMETRY / shifting up beams
move_15 = Move(Geometry=surface_3, Motion=unit_z_2)  # -> Geometry, Transform

# ---- group: GEOMETRY / beam depth_x
unit_z_4 = UnitZ(Factor=expr("-x", panel_53))
panel_93 = Panel(move_15.Geometry)

# ---- group: GEOMETRY / beam depth_x / pathmapping
panel_94 = Panel(unit_z_4)
path_mapper_17 = PathMapper(panel_94, source="{A}(i)", target="{A;i}")
panel_95 = Panel(path_mapper_17)

# ---- group: GEOMETRY
extrude_4 = Extrude(Base=move_15.Geometry, Direction=panel_95)
cap_holes_2 = CapHoles(Brep=extrude_4)
trim_tree_3 = TrimTree(Tree=cap_holes_2, Depth=1)
solid_union = SolidUnion(Breps=trim_tree_3)
custom_preview_5 = CustomPreview(Geometry=solid_union, Material=colour_swatch)

# ---- group: GEOMETRY / lines
deconstruct_brep_4 = DeconstructBrep(Brep=solid_union)  # -> Faces, Edges, Vertices
custom_preview_lineweights_5 = CustomPreviewLineweights(Geometry=deconstruct_brep_4.Edges, Shader=ColourSwatch(SwatchColor=RGB(0, 0, 0)), Absolute=False)

# ---- group: beams and columns 2d / beam width_y / cascading points for rectangle
end_points_2 = EndPoints(Curve=simplify(curve_10))  # -> Start, End
division_7 = Division(A=panel_42, B="2")
unit_x_9 = UnitX(Factor=expr("-x", division_7))  # -> simplify(graft(UnitVector))
unit_x_10 = UnitX(Factor=division_7)  # -> simplify(graft(UnitVector))
panel_96 = Panel(end_points_2.End)

# ---- group: beams and columns 2d / beam width_y / for column
unit_y_9 = UnitY(Factor=expr("-x", panel_48))  # -> simplify(graft(UnitVector))
unit_y_10 = UnitY(Factor=panel_48)  # -> simplify(graft(UnitVector))
move_16 = Move(Geometry=[end_points_2.End, end_points_2.Start], Motion=[unit_y_9, unit_y_10])  # -> Geometry, Transform

# ---- group: beams and columns 2d / beam width_y / cascading points for rectangle (continued)
move_17 = Move(Geometry=move_16.Geometry, Motion=[unit_x_10, unit_x_9])  # -> Geometry, Transform
panel_97 = Panel(move_17.Geometry)
list_item_22 = ListItem(List=move_17.Geometry, Index=0, Wrap=True)  # -> Item, Item1

# ---- group: beams and columns 2d / beam width_y (continued)
panel_98 = Panel(move_16.Geometry)

# ---- group: beams and columns 2d / beam width_y / rectangles
rectangle_2pt_10 = Rectangle2Pt(Plane=PlaneXY(0, 0, 0), PointA=list_item_22.Item, PointB=list_item_22.Item1, Radius=0)  # -> Rectangle, Length
surface_4 = Surface(rectangle_2pt_10.Rectangle)

# ---- group: beams and columns 2d / beam width_y / 2D
colour_swatch_2 = ColourSwatch(SwatchColor=RGBA(255, 68, 0, 180))
custom_preview_6 = CustomPreview(Geometry=surface_4, Material=colour_swatch_2)

# ---- group: GEOMETRY / shifting up beams
move_18 = Move(Geometry=surface_4, Motion=unit_z_2)  # -> Geometry, Transform

# ---- group: GEOMETRY / beam depth_y
unit_z_5 = UnitZ(Factor=expr("-x", panel_57))
panel_99 = Panel(move_18.Geometry)

# ---- group: GEOMETRY / beam depth_y / pathmapping
panel_100 = Panel(unit_z_5)
path_mapper_18 = PathMapper(panel_100, source="{A}(i)", target="{A;i}")
panel_101 = Panel(path_mapper_18)

# ---- group: GEOMETRY
extrude_5 = Extrude(Base=move_18.Geometry, Direction=panel_101)
cap_holes_3 = CapHoles(Brep=extrude_5)
trim_tree_4 = TrimTree(Tree=cap_holes_3, Depth=1)
solid_union_2 = SolidUnion(Breps=trim_tree_4)
custom_preview_7 = CustomPreview(Geometry=solid_union_2, Material=colour_swatch_2)

# ----
geometry = Geometry([cap_holes, trim_tree_4, cap_holes_2])

# ---- group: CONNECTORS / removing 1st and last tree branch
x_4 = Panel(x)
panel_103 = Panel("{*;*}[0]")

list_length_7 = ListLength(List=x_4)
addition_6 = Addition(A=list_length_7, B="1")

# ---- group: CONNECTORS / removing 1st and last tree branch / removing first of A tree and last of B tree
panel_104 = Panel(list_length_7)
concatenate_3 = Concatenate(Fragment_A="{*;*}[", Fragment_B=panel_104, A="]")  # -> simplify(Result)
panel_105 = Panel(concatenate_3)

# ---- group: CONNECTORS
split_tree_4 = SplitTree(Data=cap_holes, Masks=flatten(panel_103))  # -> Positive, Negative
panel_106 = Panel(split_tree_4.Negative)
clean_tree_6 = CleanTree(RemoveNulls=True, RemoveInvalid=True, RemoveEmpty=True, Tree=split_tree_4.Negative)
brep = Brep(solid_union_2)
brep_2 = Brep(solid_union)

# ---- group: CONNECTORS / removing 1st and last tree branch (continued)
split_tree_5 = SplitTree(Data=cap_holes, Masks=flatten(panel_105))  # -> Positive, Negative
panel_107 = Panel(split_tree_5.Negative)
clean_tree_7 = CleanTree(RemoveNulls=True, RemoveInvalid=True, RemoveEmpty=True, Tree=split_tree_5.Negative)
# CONNECTORS (2D)
panel_108 = Panel(clean_tree_7)
panel_109 = Panel(clean_tree_6)

# ---- group: CONNECTORS / connectors for y beams / choosing beam
panel_110 = Panel("1")
panel_111 = Panel("1")
tree_branch_14 = TreeBranch(Tree=brep_2, Path=panel_110, MaintainPaths=True)
tree_item_3 = TreeItem(Tree=brep_2, Path=panel_110, Index=panel_111, Wrap=True)

panel_112 = Panel("1")
panel_113 = Panel("1")
tree_item_4 = TreeItem(Tree=brep, Path=panel_112, Index=panel_113, Wrap=True)
tree_branch_15 = TreeBranch(Tree=brep, Path=panel_112, MaintainPaths=True)

# ---- group: CONNECTORS / connectors for y beams / surface
deconstruct_brep_5 = DeconstructBrep(Brep=brep_2)  # -> Faces, Edges, Vertices
list_item_23 = ListItem(List=deconstruct_brep_5.Faces, Index=0, Wrap=True)  # -> Item, Item1, Item2, Item3, Item4
surface_5 = Surface(list_item_23.Item4)
surface_6 = Surface(list_item_23.Item2)

deconstruct_brep_6 = DeconstructBrep(Brep=brep)  # -> Faces, Edges, Vertices
list_item_24 = ListItem(List=deconstruct_brep_6.Faces, Index=0, Wrap=True)  # -> Item, Item1, Item2, Item3
surface_7 = Surface(list_item_24.Item3)
surface_8 = Surface(list_item_24.Item1)

# ---- group: CONNECTORS / connectors for y beams / choosing column A for y beam
panel_114 = Panel(panel_110)
panel_115 = Panel(panel_111)
tree_branch_16 = TreeBranch(Tree=clean_tree_7, Path=panel_114, MaintainPaths=True)
tree_item_5 = TreeItem(Tree=clean_tree_7, Path=panel_114, Index=panel_115, Wrap=True)

# ---- group: CONNECTORS / connectors for y beams / choosing column B for y beam
panel_116 = Panel(panel_110)
panel_117 = Panel(panel_111)
tree_item_6 = TreeItem(Tree=clean_tree_6, Path=panel_116, Index=panel_117, Wrap=True)

panel_118 = Panel(panel_112)
panel_119 = Panel(panel_113)
tree_item_7 = TreeItem(Tree=clean_tree_5, Path=panel_118, Index=panel_119, Wrap=True)

# ---- group: CONNECTORS / connectors for y beams / choosing column A for y beam
panel_120 = Panel(panel_112)
panel_121 = Panel(panel_113)
tree_branch_17 = TreeBranch(Tree=clean_tree_4, Path=panel_120, MaintainPaths=True)
tree_item_8 = TreeItem(Tree=clean_tree_4, Path=panel_120, Index=panel_121, Wrap=True)

# ---- group: CONNECTORS / connectors for y beams / connecting line
area_3 = Area(Geometry=surface_6)  # -> Area, Centroid
trim_tree_5 = TrimTree(Tree=area_3.Centroid, Depth=1)
brep_closest_point = BrepClosestPoint(Point=graft(trim_tree_5), Brep=graft(clean_tree_6))  # -> Point, Normal, Distance
line_21 = Line(StartPoint=area_3.Centroid, EndPoint=brep_closest_point.Point)

area_4 = Area(Geometry=surface_7)  # -> Area, Centroid
trim_tree_6 = TrimTree(Tree=area_4.Centroid, Depth=1)
brep_closest_point_2 = BrepClosestPoint(Point=graft(trim_tree_6), Brep=graft(clean_tree_5))  # -> Point, Normal, Distance
line_22 = Line(StartPoint=area_4.Centroid, EndPoint=brep_closest_point_2.Point)

area_5 = Area(Geometry=surface_5)  # -> Area, Centroid

# ---- group: CONNECTORS / connectors for y beams
trim_tree_7 = TrimTree(Tree=area_5.Centroid, Depth=1)

# ---- group: CONNECTORS / connectors for y beams / connecting line (continued)
brep_closest_point_3 = BrepClosestPoint(Point=graft(trim_tree_7), Brep=graft(clean_tree_7))  # -> Point, Normal, Distance
line_23 = Line(StartPoint=area_5.Centroid, EndPoint=brep_closest_point_3.Point)

area_6 = Area(Geometry=surface_8)  # -> Area, Centroid

# ---- group: CONNECTORS / connectors for y beams
trim_tree_8 = TrimTree(Tree=area_6.Centroid, Depth=1)

# ---- group: CONNECTORS / connectors for y beams / connecting line (continued)
brep_closest_point_4 = BrepClosestPoint(Point=graft(trim_tree_8), Brep=graft(clean_tree_4))  # -> Point, Normal, Distance
line_24 = Line(StartPoint=area_6.Centroid, EndPoint=brep_closest_point_4.Point)

# ---- group: CONNECTORS
curve_11 = Curve([line_23, line_21, line_24, line_22])
pipe = Pipe(Curve=curve_11, Radius=Slider(0.036, range=0..0.1), Caps=0)
custom_preview_8 = CustomPreview(Geometry=pipe, Material=ColourSwatch(SwatchColor=RGB(232, 107, 107)))
